# Dynamo graph ejemplo2.dyn (Dynamo 2.0.2.6826)

file_path = Filename("C:\Users\juan\Desktop\SCRIPS_PYTHON\DYNAMO\sample2\ejemplo2.py")
readText = FileSystem.ReadText(file=file_path)
code_block = CodeBlock { 0; 2; 3; }
python_script_from_string = PythonStringNode(script=readText, IN[0]=code_block.out0, IN[1]=code_block.out1, IN[2]=code_block.out2)
