# Dynamo graph ejemplo3.dyn (Dynamo 2.0.2.6826)

file_path = Filename(".\ejemplo3.py")
readText = FileSystem.ReadText(file=file_path)
code_block = CodeBlock { 1.2; 30; }
python_script_from_string = PythonStringNode(script=readText, IN[0]=code_block.out0, IN[1]=code_block.out1)
